# Grasshopper definition Asynchronous_test_check_GREEN_SCENARIO_FOLDER.gh (Grasshopper 1.0.7)
# Copyright: 2020
# plug-ins: FalseStartToggle, GHWind

brep = Brep([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])

exceptions = Panel("8")
cluster = Cluster(I=exceptions)
panel = Panel("""14
4
6""")
branch = TreeBranch(Path=cluster, MaintainPaths=True)
branch_2 = TreeBranch(Path=panel, MaintainPaths=True)
# WIND SIMULATIONS!
meshit = MeshItMANI11(mesh_brep=flatten(brep))
branch_3 = TreeBranch(Tree=branch, Path=Slider(9, range=0..15), MaintainPaths=True)
cluster_2 = Cluster_3(
    geo=meshit,
    scale_0_5_2_0=Slider(0.3, range=0.2..2),
    scale_z_0_5_2_0=Slider(0.7, range=0.2..2),
    cellsize_x="4",
    cellsize_y="4",
    cellsize_z="8",
    maxcells="500000")  # -> int_5, int_4, int_6, xyz_size, xyz_cells, mesh_3, origin_2, total_cells_3000000_2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
toggle = FalseStartToggle(False)
panel_2 = Panel("1.511e-5;1e-4;1;10;2;false;0.7;false;0.01")
discretize_meshes = GHDiscrMesh(Xyzsize=cluster_2.xyz_size, Xyzcells=cluster_2.xyz_cells, SolidMesh=cluster_2.mesh_3, Origin=cluster_2.origin_2)  # -> Boxes, CubesAsDoubles
division = Division(A=cluster_2.int_5, B="5")
multiplication = Multiplication(A=division, B=0.8)
number_slider = Slider(2, range=0..3)
toggle_2 = BooleanToggle(True)
toggle_3 = BooleanToggle(True)
export_geometry = GHExportGeometry(CubesAsDoubles=discretize_meshes.CubesAsDoubles, Path="c:\_CHRIS\geometry.csv", Export=Button())
number_slider_2 = Slider(1, range=0..100)
number_slider_3 = Slider(0, range=0..5000)
number_slider_4 = Slider(5, range=0..5000)
number_slider_5 = Slider(2, range=0..2)
toggle_4 = BooleanToggle(False)
Z = UnitZ(Factor="-2")

f = PythonScript(x=cluster_2.total_cells_3000000_2)  # -> a
# ---------- f: Python ----------
def human_format(num):
    num = float('{:.2g}'.format(num))
    magnitude = 0
    while abs(num) >= 1000:
        magnitude += 1
        num /= 1000.0
    return '{}{}'.format('{:f}'.format(num).rstrip('0').rstrip('.'), ['', 'K', 'M', 'B', 'T'][magnitude])
    
a = human_format(x)
# ---------- end f ----------
int = Integer(multiplication)
task_finished = GHFFDSolverAsync(
    DomainSize=cluster_2.xyz_size,
    DomainDiscretization=cluster_2.xyz_cells,
    Geometry=discretize_meshes.CubesAsDoubles,
    TimeStep="2",
    Horizon=int,
    WindSpeed="5",
    TerrainMode=number_slider,
    Run=Button(),
    Results=toggle_2,
    Reset=Button(),
    SolverParameters=panel_2,
    Residuals=toggle_3,
    Mean_dt="10",
    Stop=Button())  # -> VCentred, PCentred, VStaggered, PStaggered, DE, ObstDomain, FfdSolver, Domain, Fs
results = GHResultsviewer(Input=task_finished.FfdSolver)  # -> VCentred, PCentred, VStaggered, PStaggered, DE, ObstDomain, FfdSolver

no_of_cells_1_million_is_around_1_hour = Panel(f)
ffd_v2 = FFDSolverV2(
    DomainSize=cluster_2.xyz_size,
    DomainDiscretization=cluster_2.xyz_cells,
    Geometry=discretize_meshes.CubesAsDoubles,
    TimeStep="2",
    Horizon=int,
    WindSpeed="5",
    Terrain=number_slider,
    Run=toggle,
    Results=toggle_2,
    Reset=Button(),
    SolverParameters=panel_2,
    Residuals=toggle_3,
    Mean_dt="10")  # -> VCentred, PCentred, VStaggered, PStaggered, DE, ObstDomain
field_visualizer = FFDDynamicFieldVisualizer(
    Origin=cluster_2.origin_2,
    XyzSection=number_slider_5,
    SectionPosition=number_slider_2,
    Min=number_slider_3,
    Max=number_slider_4,
    Velocity=results.VStaggered,
    Pressure=results.PStaggered,
    Hx=cluster_2.R,
    Hy=cluster_2.R_2,
    Hz=cluster_2.R_3,
    ShowPressure=toggle_4,
    ColourSheme=Slider(1, range=0..2))
vector_visualizer = FFDDynamicVectorVisualizer(
    Origin=cluster_2.origin_2,
    XyzSection=number_slider_5,
    SectionPosition=number_slider_2,
    Min=number_slider_3,
    Max=number_slider_4,
    Velocity=results.VCentred,
    Pressure=results.PCentred,
    Hx=cluster_2.R,
    Hy=cluster_2.R_2,
    Hz=cluster_2.R_2,
    ShowPressure=toggle_4,
    ColourSheme=Slider(1, range=0..2))  # disabled
cull = CullPattern(List=vector_visualizer, CullPattern=[False, True])
move = Move(Geometry=field_visualizer, Motion=Z)  # -> Geometry, Transform
mesh = Mesh(move.Geometry)
line = Line(cull)

# ==== cluster Cluster
T = ClusterInput()
tstat = TreeStatistics(Tree=T)  # -> Paths, Length, Count
series = Series(Start=0, Step=1, Count=tstat.Count)  # -> simplify(Series)
I = ClusterInput()
cull_i = CullIndex(List=series, Indices=I, Wrap=True)
L = ClusterOutput(cull_i)

# ==== cluster Cluster_3
maxcells = ClusterInput()
maxcells_2 = Number(maxcells)
geo = ClusterInput()
geo_2 = Geometry(geo)
scale_0_5_2_0 = ClusterInput()
scale_z_0_5_2_0 = ClusterInput()
meshit = MeshItMANI11(mesh_brep=flatten(geo_2))
scale_z_0_5_2_0_2 = Number(scale_z_0_5_2_0)
scale_0_5_2_0_2 = Number(scale_0_5_2_0)
mesh = Mesh(meshit)
cellsize_x = ClusterInput()
cellsize_y = ClusterInput()
cellsize_z = ClusterInput()
bbox = BoundingBox(Content=mesh, Plane=PlaneXY(0, 0, 0), UnionBox=True)  # -> Box, Box_2
default = DefaultMANI(data=scale_0_5_2_0_2, default_value_flattened=Slider(0.9, range=0.5..2))
default_2 = DefaultMANI(data=scale_z_0_5_2_0_2, default_value_flattened=Slider(0.9, range=0.5..2))
cellsize_x_2 = Number(cellsize_x)
cellsize_y_2 = Number(cellsize_y)
box = EvaluateBox(Box=bbox.Box, UParameter=0.5, VParameter=0.5, WParameter=0)  # -> Plane, Point, Include
bbox_2 = BoundingBox(Content=mesh, Plane=box.Plane, UnionBox=True)  # -> Box, Box_2
box_2 = Box(bbox_2.Box)
cellsize_z_2 = Number(cellsize_z)
end = Panel("3")
sides = Panel("1.3")
box_3 = EvaluateBox(Box=box_2, UParameter=0, VParameter=0, WParameter=0)  # -> Plane, Point, Include
default_3 = DefaultMANI(data=flatten(cellsize_x_2), default_value_flattened=flatten("2"))
default_4 = DefaultMANI(data=flatten(cellsize_y_2), default_value_flattened=flatten("2"))
default_5 = DefaultMANI(data=flatten(cellsize_z_2), default_value_flattened=flatten("4"))
debox = DeconstructBox(Box=box_2)  # -> Plane, X, Y, Z
box_4 = EvaluateBox(Box=box_2, UParameter=1, VParameter=1, WParameter=1)  # -> Plane, Point, Include
dedomain = DeconstructDomain(Domain=debox.Z)  # -> Start, End
panel = Panel("4")
dist = Distance(PointA=box_3.Point, PointB=box_4.Point)
dedomain_2 = DeconstructDomain(Domain=debox.Y)  # -> Start, End
dedomain_3 = DeconstructDomain(Domain=debox.X)  # -> Start, End
multiplication = Multiplication(A=dedomain.End, B=4.5)
multiplication_2 = Multiplication(A=dedomain.End, B=4)
addition = Addition(A=dedomain.End, B=dist)
multiplication_3 = Multiplication(A=dist, B=end)
multiplication_4 = Multiplication(A=dist, B=sides)
subtraction = Subtraction(A=dedomain_2.Start, B=multiplication_4)
addition_2 = Addition(A=dedomain_2.End, B=multiplication_4)
max = Maximum(A=addition, B=multiplication_2)
subtraction_2 = Subtraction(A=dedomain_3.Start, B=multiplication_4)
addition_3 = Addition(A=dedomain_3.End, B=multiplication_3)
min = Minimum(A=max, B=multiplication)
multiplication_5 = Multiplication(A=dedomain.Start, B=default)
multiplication_6 = Multiplication(A=min, B=default_2)
multiplication_7 = Multiplication(A=subtraction_2, B=default)
multiplication_8 = Multiplication(A=addition_3, B=default)
multiplication_9 = Multiplication(A=subtraction, B=default)
multiplication_10 = Multiplication(A=addition_2, B=default)
dom = ConstructDomain(DomainStart=multiplication_7, DomainEnd=multiplication_8)
dom_2 = ConstructDomain(DomainStart=multiplication_9, DomainEnd=multiplication_10)
dom_3 = ConstructDomain(DomainStart=multiplication_5, DomainEnd=multiplication_6)
cluster = Cluster_2(I=dom)
cluster_2 = Cluster_2(I=dom_3)
cluster_3 = Cluster_2(I=dom_2)
hx = Number(default_3)
hz = Number(default_5)
hy = Number(default_4)
int = Integer(cluster_2)
division = Division(A=int, B=default_5)
z = Integer(division)
box_5 = DomainBox(Base=box.Point, X=dom, Y=dom_2, Z=dom_3)
int_2 = Integer(cluster_3)
division_2 = Division(A=int_2, B=default_4)
y = Integer(division_2)
int_3 = Integer(cluster)
division_3 = Division(A=int_3, B=default_3)
x = Integer(division_3)
multiplication_11 = Multiplication(A=x, B=y)
multiplication_12 = Multiplication(A=multiplication_11, B=z)
division_4 = Division(A=maxcells_2, B=multiplication_12)
default_6 = DefaultMANI(data=flatten(division_4), default_value_flattened=flatten("1"))
min_2 = Minimum(A=default_6, B="1")
multiplication_13 = Multiplication(A=y, B=min_2)
multiplication_14 = Multiplication(A=x, B=min_2)
multiplication_15 = Multiplication(A=z, B=min_2)
entwine = Entwine(Branch00=multiplication_14, Branch01=multiplication_13, Branch02=multiplication_15, FlattenInputs=True)  # -> flatten(XYZCells)
Z = UnitZ(Factor="-0.0001")
division_5 = Division(A=hz, B=min_2)
division_6 = Division(A=hy, B=min_2)
division_7 = Division(A=hx, B=min_2)
box_6 = EvaluateBox(Box=box_5, UParameter=0, VParameter=0, WParameter=0)  # -> Plane, Point, Include
move = Move(Geometry=box_6.Point, Motion=Z)  # -> Geometry, Transform
total_cells_3000000 = Number(multiplication_12)
int_4 = ClusterOutput(int_2)
int_5 = ClusterOutput(int_3)
int_6 = ClusterOutput(int)
R = ClusterOutput(division_7)
R_2 = ClusterOutput(division_6)
R_3 = ClusterOutput(division_5)
origin = Point(move.Geometry)
mesh_2 = Mesh(meshit)
entwine_2 = Entwine(Branch00=int_3, Branch01=int_2, Branch02=int, FlattenInputs=True)  # -> flatten(XYZSize)
xyz_cells = ClusterOutput(entwine)
total_cells_3000000_2 = ClusterOutput(total_cells_3000000)
brep = Brep(box_5)
origin_2 = ClusterOutput(origin)
mesh_3 = ClusterOutput(mesh_2)
xyz_size = ClusterOutput(entwine_2)
debrep = DeconstructBrep(Brep=brep)  # -> Faces, Edges, Vertices
wires = BrepWireframe(Brep=brep, Density=-1)
y_2 = Integer(multiplication_13)
z_2 = Integer(multiplication_15)
x_2 = Integer(multiplication_14)
item = ListItem(List=debrep.Faces, Index=Slider(2, range=0..5), Wrap=True)
division_8 = Division(A=x_2, B="2")
division_9 = Division(A=y_2, B="2")
item_2 = ListItem(List=debrep.Faces, Index=Slider(1, range=0..5), Wrap=True)
item_3 = ListItem(List=debrep.Faces, Index=Slider(4, range=0..5), Wrap=True)
area = Area(Geometry=item_3)  # -> Area, Centroid
mesh_uv = MeshSurface(Surface=item, UCount="1", VCount=z_2, Overhang=True, Equalize=False)
scale = Scale(Geometry=item_3, Center=box.Point, Factor=0.5)  # -> Geometry, Transform
mesh_uv_2 = MeshSurface(Surface=item_2, UCount="1", VCount=z_2, Overhang=True, Equalize=False)
mesh_uv_3 = MeshSurface(Surface=scale.Geometry, UCount=division_9, VCount=division_8, Overhang=True, Equalize=False)
medges = MeshEdges(Mesh=mesh_uv)  # -> NakedEdges, InteriorEdges, NonManifoldEdges
medges_2 = MeshEdges(Mesh=mesh_uv_2)  # -> NakedEdges, InteriorEdges, NonManifoldEdges
medges_3 = MeshEdges(Mesh=mesh_uv_3)  # -> NakedEdges, InteriorEdges, NonManifoldEdges

# ==== cluster Cluster_2
I = ClusterInput()
dedomain = DeconstructDomain(Domain=I)  # -> Start, End
subtraction = Subtraction(A=dedomain.End, B=dedomain.Start)
R = ClusterOutput(subtraction)

# ==== cluster MeshItMANI11
mesh_brep = ClusterInput()
mesh_brep_2 = Geometry(simplify(mesh_brep))
group = Group(Objects=mesh_brep_2)
sortbytype = SortObjectsByType(RhinoObjects=mesh_brep_2)  # -> Points, Curves, Surfaces, Breps, Meshes, TextObjects, HatchObjects, LightObjects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
mesh = MeshBrep(
    Brep=[sortbytype.Breps, sortbytype.Extrusions, sortbytype.Surfaces],
    Settings={GridMaxCount=0, GridMinCount=16, JaggedSeams=False, MaxEdgeLength=0, MinEdgeLength=0.0001, MinTolerance=0, Refine=True, RefineAngle=0, RelativeTolerance=0.65, SimplePlanes=True, Tolerance=0})
mjoin = MeshJoin(Meshes=[sortbytype.Meshes, mesh])
unflatten = UnflattenTree(Tree=mjoin, Guide=group)
mesh_joined = Mesh(unflatten)
mesh_joined_2 = ClusterOutput(mesh_joined)

# ==== cluster DefaultMANI
default_value_flattened = ClusterInput()
data = ClusterInput()
data_2 = Data(data)
default_value_flattened_2 = Data(flatten(default_value_flattened))
merge = Merge(Data1=flatten(data_2), Data2="0")  # -> flatten(Result)
lng = ListLength(List=merge)
equals = Equality(FirstNumber=lng, SecondNumber="1")  # -> Equality, Inequality
cull = CullPattern(List=data_2, CullPattern=invert(equals.Equality))
panel = Panel(equals.Equality)
cull_2 = CullPattern(List=default_value_flattened_2, CullPattern=equals.Equality)
data_3 = Data([cull, cull_2])
data_4 = ClusterOutput(data_3)
